# Dynamo graph LINKarkitektur_BBRAPICall_v1.0.dyn (Dynamo 2.2.1.5175)

# group: INPUTS
# note: Brug denne gruppe farve for program inputs (sliders, codeblocks, etc.)

# group: DESIGN
# note: Brug denne gruppe farve for programmens typiske funktioner.

# group: PYTHON
# note: Brug denne gruppe farve til Python noder og enhver anden node som associeres med scriptet.

# group: IMPORT
# note: Brug denne gruppe farve til noder som bruges til geometri importering.

# group: LINKarkitektur_BBRAPICall
# note: Filnavn
# LINKarkitektur_BBRAPICall_v1.0.dyn
# note: Version
# Script Version - 1.0
# Dynamo Version - 2.3.0
# note: Forfatter
# LINK arkitektur
# note: Pakker & Bibliotek Afhængigheder
# Dynamo basis
# LINKarkitektur
# JsonData
# note: Beskrivelse
# Denne graph laver webrequests til DAWA (Danmarks Adressers Web API). Ud fra projektets placering, der er angivet under Manage > Location > Project Address, indhenter graphen BBR oplysninger og skriver dem til Project Information.
# Forventede parametre:
# BuildingID
# LandTitleName
# LandTitleNumber
# SiteAddress
# SiteNumber
# YearOfConstruction
# OBS. Denne graph beror på at bygningen er oprettet i BBR registret.
# note: Forbehold
# - Tag altid backup inden at scriptet køres. Synkronisere derfor med centralmodellen først.
# - Brug er på eget ansvar
# - Vær opmærksom på at selvom at dette script giver gule fejlmeldinger på nogle noder, så kan det være at scriptet stadigt er udført korrekt.
# note: Kontakt
# Venligst send alle kommentarer og fejlmeldinger til lab@linkarkitektur.dk
application_DefinitionRunLogger = Custom[Application_DefinitionRunLogger]()  # This records the username, time and document filepath when the definition is executed.

# group: SiteLocation
siteLocation = SiteLocation()
longitude = DynamoUnits.Location.Longitude(location=siteLocation)
latitude = DynamoUnits.Location.Latitude(location=siteLocation)
join = List.Join(list0=longitude, list1=latitude)
number = DoubleInput(8)
numberToString = Custom[NumberToString](num=join, digits=number)  # Converts a double to a string representation.

# group: GetBuildingAtSiteLocation
curl = StringInput("https://dawa.aws.dk/bygninger?cirkel=")
code_block = CodeBlock(url=curl, longitude=numberToString, latitude=numberToString) { url+longitude[0]+","+latitude[1]+","+"1&struktur=flad"; }
web_request = WebRequest(url=code_block)
string = JsonData.Utilities.Parse.String(jsonString=web_request)
toDictionary = JsonData.Elements.JsonObject.ToDictionary(jsonObject=string)

# group: bbrbygning_id
string_2 = StringInput("https://dawa.aws.dk/bbrlight/bygninger/")
code_block_2 = CodeBlock { "bbrbygning_id"; }
valueAtKey = DesignScript.Builtin.Dictionary.ValueAtKey(dictionary=toDictionary, key=code_block_2)
code_block_3 = CodeBlock(url=string_2, id=valueAtKey) { url+id; }
web_request_2 = WebRequest(url=code_block_3)
string_3 = JsonData.Utilities.Parse.String(jsonString=web_request_2)
toDictionary_2 = JsonData.Elements.JsonObject.ToDictionary(jsonObject=string_3)

# group: BuildDictionary
code_block_4 = CodeBlock()
# ---------- code_block_4.designscript (8 lines) ----------
[
"Bygningsnr",
"ESREjdNr",
"MatrNr",
"Landsejerlavkode",
"AdgAdr_id",
"OPFOERELSE_AAR"
];
# ----------------------------------------
valueAtKey_2 = DesignScript.Builtin.Dictionary.ValueAtKey(dictionary=toDictionary_2, key=code_block_4, lacing=Longest)
byKeysValues = DesignScript.Builtin.Dictionary.ByKeysValues(keys=code_block_4, values=valueAtKey_2)

# group: Landsejerlavkode
code_block_5 = CodeBlock { "Landsejerlavkode"; }
curl_2 = StringInput("https://dawa.aws.dk/ejerlav/")
valueAtKey_3 = DesignScript.Builtin.Dictionary.ValueAtKey(dictionary=byKeysValues, key=code_block_5)
code_block_6 = CodeBlock(url=curl_2, AdgAdr_id=valueAtKey_3) { url+AdgAdr_id+"?struktur=flad"; }
web_request_3 = WebRequest(url=code_block_6)
string_4 = JsonData.Utilities.Parse.String(jsonString=web_request_3)
toDictionary_3 = JsonData.Elements.JsonObject.ToDictionary(jsonObject=string_4)

# group: AdgAdr_id
code_block_7 = CodeBlock { "AdgAdr_id"; }
curl_3 = StringInput("https://dawa.aws.dk/adgangsadresser/")
valueAtKey_4 = DesignScript.Builtin.Dictionary.ValueAtKey(dictionary=byKeysValues, key=code_block_7)
code_block_8 = CodeBlock(url=curl_3, AdgAdr_id=valueAtKey_4) { url+AdgAdr_id+"?struktur=flad"; }
web_request_4 = WebRequest(url=code_block_8)
string_5 = JsonData.Utilities.Parse.String(jsonString=web_request_4)
toDictionary_4 = JsonData.Elements.JsonObject.ToDictionary(jsonObject=string_5)

list_create = List.Create(item0=code_block_5, item1=code_block_7)
code_block_9 = CodeBlock { "navn"; }
valueAtKey_5 = DesignScript.Builtin.Dictionary.ValueAtKey(dictionary=toDictionary_3, key=code_block_9)
code_block_10 = CodeBlock()
# ---------- code_block_10.designscript (6 lines) ----------
[
"vejnavn",
"husnr",
"postnr",
"postnrnavn"
];
# ----------------------------------------
valueAtKey_6 = DesignScript.Builtin.Dictionary.ValueAtKey(dictionary=toDictionary_4, key=code_block_10)
byKeysValues_2 = DesignScript.Builtin.Dictionary.ByKeysValues(keys=code_block_10, values=valueAtKey_6)
list_create_2 = List.Create(item0=valueAtKey_5, item1=byKeysValues_2)
setValueAtKeys = DesignScript.Builtin.Dictionary.SetValueAtKeys(dictionary=byKeysValues, keys=list_create, values=list_create_2)
components = DesignScript.Builtin.Dictionary.Components(dictionary=setValueAtKeys)
sortByKey = List.SortByKey(list=components.values, keys=components.keys)

# group: BuildAddress
code_block_11 = CodeBlock { "AdgAdr_id"; }
valueAtKey_7 = DesignScript.Builtin.Dictionary.ValueAtKey(dictionary=setValueAtKeys, key=code_block_11)
values = DesignScript.Builtin.Dictionary.Values(dictionary=valueAtKey_7)
code_block_12 = CodeBlock(input=values) { input[2]+" "+input[1]+", "+input[3]+" "+input[0]; }

# group: SetProjectInfo
code_block_13 = CodeBlock { "Project Information"; }
byName = Category.ByName(name=code_block_13)
all_elements_of_category = ElementsOfCategory(Category=byName)
code_block_14 = CodeBlock()
# ---------- code_block_14.designscript (8 lines) ----------
[
"SiteAddress",
"BuildingID",
"SiteNumber",
"LandTitleName",
"LandTitleNumber",
"YearOfConstruction"
];
# ----------------------------------------
code_block_15 = CodeBlock { 0; }
replaceItemAtIndex = List.ReplaceItemAtIndex(list=sortByKey.sorted_list, index=code_block_15, item=code_block_12)

string_from_object = FromObject(obj=replaceItemAtIndex)

# group (continued): SetProjectInfo
setParameterByName = Element.SetParameterByName(element=all_elements_of_category, parameterName=code_block_14, value=string_from_object, lacing=Longest)

# group: UI Message
code_block_16 = CodeBlock(param=code_block_14, val=string_from_object) { param+": "+val; }
the_following_data_was_imported = Watch(code_block_16)  # "The following data was imported from DAWA (Danmarks Adressers Web API)"; graph output

have_you_set_the_project_address = BoolSelector(false)  # "Have you set the Project Address? (Manage > Location > Move the pin)"; graph input
